vi "Function.gvi"   [LabVIEW Communications System Design Suite 2.0.1]
panel controls:
  "change backoff": bool
  "initial value": i32
panel indicators:
  "Backoff": i32
diagram:
  Feedback Node(initial value=$"initial value", input=w1) -> w2
  case (w2) {
    frame 8 {
      Select(s=$"change backoff", t=4, f=w2) -> w1
    }
    frame 4, Default {
      Select(s=$"change backoff", t=8, f=w2) -> w1
    }
  }
  $Backoff <- w1
