vi "state machine- switch among states.gvi"   [LabVIEW Communications System Design Suite 2.0.1]
panel controls:
  "to state 2": bool
  "to state1": bool
  "to state 3": bool
  "to state 4": bool
  "true for stop": bool
panel indicators:
  "current state": enum{"state 0", "state 1", "state 2", "state 3"}
diagram:
  # create the state machine
  # enum constant for case
  while {
    case ("state 0") {
      frame "state 0", Default {
        # two case structure
        Select(s=$"to state1", t="state 1", f="state 0") -> w1
      }
      frame "state 1" {
        # two case structure
        Select(s=$"to state 2", t="state 2", f="state 0") -> w1
      }
      frame "state 2" {
        # two case structure
        Select(s=$"to state 3", t="state 3", f="state 0") -> w1
      }
      frame "state 3" {
        # two case structure
        Select(s=$"to state 4", t="state 0", f="state 0") -> w1
      }
    }
    $"current state" <- w1
    stop if $"true for stop"
  }
