vi "switch.gvi"   [LabVIEW Communications System Design Suite 2.0.1]
panel controls:
  "input 1": f64
  "input 2": f64
  "Enum": enum{"addiction", "multiplication", "factorial"} = "addiction"
  "Boolean": bool
panel indicators:
  "output": f64
diagram:
  while {
    case ($Enum) {
      frame "addiction", Default {
        call "addiction.gvi"(input 1=$"input 1", input 2=$"input 2") -> (result=w1)
      }
      frame "multiplication" {
        call "multiply.gvi"(input 1=$"input 1", input 2=$"input 2") -> (result=w1)
      }
      frame "factorial" {
        call "factorial.gvi"(input=$"input 1") -> (result=w1)
      }
    }
    $output <- w1
    stop if $Boolean
  }
