vi "host switching.gvi"   [LabVIEW Communications System Design Suite 2.0.1]
panel controls:
  "stop": bool
  "enqueue": bool
  "Enum": enum{"queue 2", "queue 1"} = "queue 2"
  "dequeue": bool
  "flush": bool
  "Boolean": bool
panel indicators:
  "number elements in queue": i32
  "number elements in queue_2": i32
  "number elements after dequeuing": i32
  "number after flush": i32
  "Numeric": i32
diagram:
  w1 = $Enum
  while {
    w2 = $enqueue
    w3 = $stop
    case (w1) {
      frame "queue 2" {
        Obtain Queue(element data type=i32 0) -> (queue out=w5)
        while {
          case (w2) {
            frame False, Default {
              w6 = w5
            }
            frame True {
              Enqueue Element(element=1, queue=w5) -> (queue out=w6)
            }
          }
          Get Queue Status(queue=w6) -> (# elements in queue=w7, queue out=w4)
          $"number elements in queue_2" <- w7
          Wait(time to wait=1000)
          stop if w3
        }
      }
      frame "queue 1" {
        # obtain queue, which is a queue of  numeric constant
        Obtain Queue(element data type=i32 0) -> (queue out=w8)
        # enqueue the coressponding element into this queue, so the numeric constant i the input
        case (w2) {
          frame False, Default {
            w9 = w8
          }
          frame True {
            Enqueue Element(element=1, queue=w8) -> (queue out=w9)
          }
        }
        # the case switch loop only have one input and one output
        Get Queue Status(queue=w9) -> (# elements in queue=w10, queue out=w4)
        # various kinds of status of a queue, we need the the number of elements in it,
        $"number elements in queue" <- w10
      }
    }
    case ($dequeue) {
      frame False, Default {
        w11 = w4
      }
      frame True {
        Dequeue Element(queue=w4) -> (queue out=w12)
        Get Queue Status(queue=w12) -> (# elements in queue=w13, queue out=w11)
        $"number elements after dequeuing" <- w13
      }
    }
    case ($flush) {
      frame False, Default {
        w14 = w11
      }
      frame True {
        Flush Queue(queue=w11) -> (queue out=w14)
      }
    }
    Get Queue Status(queue=w14) -> (# elements in queue=w15)
    $"number after flush" <- w15
    Wait(time to wait=1000)
    stop if w3
  }
  Obtain Queue(element data type=i32 0) -> (queue out=w16)
  while {
    Enqueue Element(element=1, queue=w16) -> (queue out=w17)
    Get Queue Status(queue=w17) -> (# elements in queue=w18)
    $Numeric <- w18
    Wait(time to wait=1000)
    stop if $Boolean
  }
