vi "append header.gvi"   [LabVIEW Communications System Design Suite 2.0.1]
panel controls:
  "ip add 1": u32
  "ip add 2": u32
  "ip add 3": u32
  "ip add 4": u32
  "element in pack": u16
  "array constant": f64
  "packet size": i32 = 100
panel indicators:
  "output packet with headers": u32[]
diagram:
  call "array-learning.gvi"(element=$"element in pack", packet size=$"packet size") -> (Numeric=w1, subarray=w2)
  # change the terminal from floating to unsigned integer
  # array size, put the 16 bits array into 8-bit integer
  # build array
  Build Array($"ip add 1", $"ip add 2", $"ip add 3", $"ip add 4") -> w3
  Array Size(array=w2) -> (size(s)=w4)
  # <ip address><size><payload>
  To Unsigned Byte Integer(number=w4) -> w5
  # build array
  Build Array[ConcatenateInputs=True](w3, w1, w5) -> w6
  $"output packet with headers" <- w6
