vi "array-learning.gvi"   [LabVIEW Communications System Design Suite 2.0.1]
inputs:
  "element": u32
  "packet size": i32 = 100
outputs:
  "Numeric": u32
  "subarray": u32[]
diagram:
  # 1. initialize array
  # 2.
  Initialize Array(element=$element, size=$"packet size") -> w1
  Random Number() -> (number (0 to 1)=w2)
  Multiply($"packet size", w2) -> w3
  # this vi generates a randomly-sized array (0 to 99 elements) contaning all 57s\
  Array Subset(array=w1, index0=0, length0=w3) -> w4
  $subarray <- w4
  $Numeric <- w3
