vi "cluster.gvi"   [LabVIEW Communications System Design Suite 2.0.1]
panel controls:
  "operand 1": f64
  "operand 2": f64
  "policy": "policy.gtype" = "Max-Weight"
panel indicators:
  "product": f64
  "is it the max weight?": bool
types:
  "policy.gtype" = enum{"Max-Weight", "Deficit based", "policy 3"}
diagram:
  # enum constant can be changed to the control
  call "max weight check.gvi"(Enum Constant=$policy) -> (is it the max weight?=w1)
  $"is it the max weight?" <- w1
  # change to type defintion, then we can add more items, and it will also change the other function, who are connecting with this trype definition
  # need to change to scalar, not array
  Build Cluster($policy, $"operand 1", $"operand 2") -> w2
  # use cluster 1 as the control
  Property Node(instance in=w2) -> ("Element 1"=w3, instance out=w4)
  case (w3) {
    frame "Max-Weight", Default {
      # multiply cluter element 2 and 3
      Property Node(instance in=w4) -> ("Element 2"=w6, "Element 3"=w7)
      Multiply(w6, w7) -> w5
    }
    frame "Deficit based" {
      Property Node(instance in=w4) -> ("Element 2"=w8, "Element 3"=w9)
      Multiply(w8, w9) -> w5
    }
  }
  $product <- w5
