vi "Append Header.gvi"   [LabVIEW Communications System Design Suite 2.0.1]
panel controls:
  "element": u8
  "Packet Size (Upper Limit)": i32 = 100
  "IP add 1": u8[]
panel indicators:
  "Output Packet with Headers": u8[]
diagram:
  call "Random Data Gen.gvi"(element=$element, Packet Size (Upper Limit)=$"Packet Size (Upper Limit)") -> (subarray=w1)
  # Array
  # Size
  Array Size(array=w1) -> (size(s)=w2)
  To Unsigned Byte Integer(number=w2) -> w3
  # Build
  # Array
  Build Array[ConcatenateInputs=True]($"IP add 1", w3, w1) -> w4
  # <Ip Address><Size><Payload>
  $"Output Packet with Headers" <- w4
