vi "Function.gvi"   [LabVIEW Communications System Design Suite 2.0.1]
panel controls:
  "Operand 1": f64
  "Operand 2": f64
  "Policy": "Policy.gtype" = "Deficit Based"
panel indicators:
  "Numeric": f64
  "Is it Max Weight?": bool
types:
  "Policy.gtype" = enum{"Max-Weight", "Deficit Based", "Policy 3", "Policy 4", "Policy 5", "Policy 6"}
diagram:
  call "Max Weight Check.gvi"(Policy=$Policy) -> (Is it Max Weight?=w1)
  $"Is it Max Weight?" <- w1
  Build Cluster($Policy, $"Operand 1", $"Operand 2") -> w2
  Property Node(instance in=w2) -> ("Element 1"=w3, instance out=w4)
  case (w3) {
    frame "Max-Weight", Default {
      Property Node(instance in=w4) -> ("Element 2"=w6, "Element 3"=w7)
      Multiply(w6, w7) -> w5
    }
    frame "Deficit Based" {
      Property Node(instance in=w4) -> ("Element 2"=w8, "Element 3"=w9)
      Add(w8, w9) -> w5
    }
  }
  $Numeric <- w5
