vi "Random Data Gen.gvi"   [LabVIEW Communications System Design Suite 2.0.1]
inputs:
  "element": u8
  "Packet Size (Upper Limit)": i32 = 100
outputs:
  "subarray": u8[]
panel indicators:
  "product": f64
diagram:
  # This VI generates a randomly-sized array (0 to 100 elements) containing all 57's
  Initialize Array(element=$element, size=$"Packet Size (Upper Limit)") -> w1
  Random Number() -> (number (0 to 1)=w2)
  Multiply($"Packet Size (Upper Limit)", w2) -> w3
  Array Subset(array=w1, index0=0, length0=w3) -> w4
  $subarray <- w4
  $product <- w3
