vi "the packet header_2.gvi"   [LabVIEW Communications System Design Suite 2.0.1]
panel controls:
  "ipaddr 1": i32
  "ipaddr 2": i32
  "ipaddr 3": i32
  "ipaddr 4": i32
  "timestamp_1": i32
  "timestamp_2": i32
  "timestamp": i32
  "timestamp_3": i32
  "payload": i32
  "select to true to stop": bool = TRUE
panel indicators:
  "ip addr header": i32[]
  "ip addr header + timestamp": i32[]
  "ip + timestamp + size": i32[]
  "final result": i32[]
diagram:
  while {
    Build Array($"ipaddr 1", $"ipaddr 2", $"ipaddr 3", $"ipaddr 4") -> w1
    $"ip addr header" <- w1
    Build Array[ConcatenateInputs=True](w1, $timestamp_1, $timestamp_2, $timestamp, $timestamp_3) -> w2
    $"ip addr header + timestamp" <- w2
    Random Number() -> (number (0 to 1)=w3)
    Multiply(w3, 50) -> w4
    Add(w4, 50) -> w5
    Build Array[ConcatenateInputs=True](w2, w5, w5) -> w6
    $"ip + timestamp + size" <- w6
    Initialize Array(element=$payload, size=w5) -> w7
    Build Array[ConcatenateInputs=True](w6, w7) -> w8
    $"final result" <- w8
    Wait(time to wait=100)
    stop if $"select to true to stop"
  }
